% Simulink data dictionary PMSM_MC_Data_2023a.sldd

ACurrent_Sample = Simulink.Signal(StorageClass="ExportedGlobal", DataType="single")
BCurrent_Sample = Simulink.Signal(StorageClass="ExportedGlobal", DataType="single")
CCurrent_Sample = Simulink.Signal(StorageClass="ExportedGlobal", DataType="single")
Ecode_cnt = Simulink.Signal(StorageClass="ExportedGlobal", DataType="int32")
MC_DCurrLopKi_CFG = Simulink.Parameter(0, StorageClass="ExportedGlobal", DataType="single")
MC_DCurrLopKp_CFG = Simulink.Parameter(0, StorageClass="ExportedGlobal", DataType="single")
MC_MotModeDebug_CFG = Simulink.Parameter(255, StorageClass="ExportedGlobal", DataType="uint8")
MC_POLE_NUM_CFG = Simulink.Parameter(4, StorageClass="ExportedGlobal", DataType="uint8")
MC_QCurrLopKi_CFG = Simulink.Parameter(0, StorageClass="ExportedGlobal", DataType="single")
MC_QCurrLopKp_CFG = Simulink.Parameter(0, StorageClass="ExportedGlobal", DataType="single")
MC_SpdLopKi_CFG = Simulink.Parameter(0, StorageClass="ExportedGlobal", DataType="single")
MC_SpdLopKp_CFG = Simulink.Parameter(0, StorageClass="ExportedGlobal", DataType="single")
MotorSpdRef = Simulink.Signal(StorageClass="ExportedGlobal", DataType="int16")
SD_MosCtr = Simulink.Signal(StorageClass="ExportedGlobal", DataType="boolean")
UVoltage_PWM = Simulink.Signal(StorageClass="ExportedGlobal", DataType="single")
VBus_Sample = Simulink.Signal(StorageClass="ExportedGlobal", DataType="single")
VVoltage_PWM = Simulink.Signal(StorageClass="ExportedGlobal", DataType="single")
WVoltage_PWM = Simulink.Signal(StorageClass="ExportedGlobal", DataType="single")