% Simulink data dictionary PMSM_MC_Data_2025a.sldd

ACurrent_Sample = Simulink.Signal(StorageClass="ExportedGlobal", DataType="single")
BCurrent_Sample = Simulink.Signal(StorageClass="ExportedGlobal", DataType="single")
CCurrent_Sample = Simulink.Signal(StorageClass="ExportedGlobal", DataType="single")
Ecode_cnt = Simulink.Signal(StorageClass="ExportedGlobal", DataType="int32")
MotorSpdRef = Simulink.Signal(StorageClass="ExportedGlobal", DataType="int16")
SD_MosCtr = Simulink.Signal(StorageClass="ExportedGlobal", DataType="boolean")
UVoltage_PWM = Simulink.Signal(StorageClass="ExportedGlobal", DataType="single")
VBus_Sample = Simulink.Signal(StorageClass="ExportedGlobal", DataType="single")
VVoltage_PWM = Simulink.Signal(StorageClass="ExportedGlobal", DataType="single")
WVoltage_PWM = Simulink.Signal(StorageClass="ExportedGlobal", DataType="single")
MotorActSpd = Simulink.Signal(StorageClass="ExportedGlobal", DataType="single")
MC_MotModeDebug_CFG = Simulink.Parameter(255, StorageClass="ExportedGlobal", DataType="uint8")
OpenLoopEn_CFG = Simulink.Parameter(0, StorageClass="ExportedGlobal", DataType="boolean")
SensorLessType_CFG = Simulink.Parameter(1, StorageClass="ExportedGlobal", DataType="uint8")
MotorActSpd_Encode = Simulink.Signal(StorageClass="ExportedGlobal", DataType="single")
MotorActSpd_Est = Simulink.Signal(StorageClass="ExportedGlobal", DataType="single")
MC_POLE_NUM_CFG = Simulink.Parameter(7, StorageClass="ExportedGlobal", DataType="uint8")
MC_DCurrLopKp_CFG = Simulink.Parameter(0.0870848, StorageClass="ExportedGlobal", DataType="single")
MC_QCurrLopKp_CFG = Simulink.Parameter(0.0870848, StorageClass="ExportedGlobal", DataType="single")
MC_QCurrLopKi_CFG = Simulink.Parameter(0.008293758, StorageClass="ExportedGlobal", DataType="single")
MC_DCurrLopKi_CFG = Simulink.Parameter(0.008293758, StorageClass="ExportedGlobal", DataType="single")
MC_SpdLopKi_CFG = Simulink.Parameter(1.0e-5, StorageClass="ExportedGlobal", DataType="single")
MC_SpdLopKp_CFG = Simulink.Parameter(0.002, StorageClass="ExportedGlobal", DataType="single")
SensorLessEn_CFG = Simulink.Parameter(0, StorageClass="ExportedGlobal", DataType="boolean")